# Grasshopper definition Data Encoding_Group 03_Salva _ Irene.gh (Grasshopper 1.0.7)
# plug-ins: treesloth01, Shortest Walk in Gh, Pufferfish, MeshEdit Components, Human, Heteroptera, horsterCameraControl, Hops

curve = Curve([<curve referenced from the Rhino model> x2])  # disabled
curve_2 = Curve([<curve referenced from the Rhino model> x2])  # disabled
join_curves = JoinCurves(Curves=curve, Preserve=False)  # disabled
join_curves_2 = JoinCurves(Curves=curve_2, Preserve=False)  # disabled
loft = Loft(Curves=join_curves, Options={Adjust=False, Closed=False, LoftEnds=0, LoftSimp=0, LoftType=0, Rebuild=10, Refit=0.01})  # disabled
loft_2 = Loft(Curves=join_curves_2, Options={Adjust=False, Closed=False, LoftEnds=0, LoftSimp=0, LoftType=0, Rebuild=10, Refit=0.01})  # disabled
brep_join = BrepJoin(Breps=loft)  # -> Breps, Closed; disabled
brep_join_2 = BrepJoin(Breps=loft_2)  # -> Breps, Closed; disabled
mesh_brep = MeshBrep(
    Brep=brep_join.Breps,
    Settings={GridMaxCount=0, GridMinCount=16, JaggedSeams=False, MaxEdgeLength=0, MinEdgeLength=0.0001, MinTolerance=0, Refine=True, RefineAngle=0, RelativeTolerance=0.65, SimplePlanes=True, Tolerance=0})  # disabled
mesh_brep_2 = MeshBrep(
    Brep=brep_join_2.Breps,
    Settings={GridMaxCount=0, GridMinCount=16, JaggedSeams=False, MaxEdgeLength=0, MinEdgeLength=0.0001, MinTolerance=0, Refine=True, RefineAngle=0, RelativeTolerance=0.65, SimplePlanes=True, Tolerance=0})  # disabled
mesh_explode = MeshExplode(Mesh=mesh_brep_2, Interpolate=False)  # disabled
# Building_01
mesh_explode_2 = MeshExplode(Mesh=mesh_brep, Interpolate=False)  # disabled
deconstruct_mesh = DeconstructMesh(Mesh=mesh_explode)  # -> Vertices, Faces, Colours, Normals; disabled
mesh_area = MeshArea(Mesh=mesh_explode_2)  # -> Area, Centroid; disabled
deconstruct_mesh_2 = DeconstructMesh(Mesh=mesh_explode_2)  # -> Vertices, Faces, Colours, Normals; disabled
line = Line(StartPoint=graft(mesh_area.Centroid), EndPoint=deconstruct_mesh.Vertices)  # disabled
number_slider = Slider(0.25, range=0..1)  # disabled
colour_swatch = ColourSwatch(SwatchColor=RGB(64, 64, 64))  # disabled
face_boundaries = FaceBoundaries(Mesh=mesh_explode)  # disabled
dash_pattern = DashPattern(Curve=reparameterize(line), Pattern=number_slider)  # -> Dashes, Gaps; disabled
flatten_tree = FlattenTree(Tree=face_boundaries, Path="{0}")  # disabled

panel = Panel("http://c13f-35-247-55-5.ngrok.io")
panel_2 = Panel("http://e0e0-34-85-215-115.ngrok.io")
number_slider_2 = Slider(10, range=0..200)
number_slider_3 = Slider(1.5, range=1..1.5)
number_slider_4 = Slider(1.576, range=0..10)
number_slider_5 = Slider(10, range=0..10)
number_slider_6 = Slider(5.332, range=0..10)
number_slider_7 = Slider(0.481, range=0..1)
number_slider_8 = Slider(2.343, range=0..10)
number_slider_9 = Slider(81.01, range=0..100)
number_slider_10 = Slider(0.8242, range=0..1)
number_slider_11 = Slider(4.825, range=0..10)
# import csv_values
number_slider_12 = Slider(10, range=0..10)
number_slider_13 = Slider(6, range=0..10)
multiplication = Multiplication(A=number_slider_3, B="1.500")
t1 = Slider(1, range=0..1)
number_slider_14 = Slider(100, range=0..2000)
t1_2 = Slider(1, range=0..1)
curve_3 = Curve([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])
rectangle = Rectangle(Plane=PlaneXY(0, 0, 0), XSize=number_slider_3, YSize=multiplication, Radius=0)  # -> Rectangle, Length
number_slider_15 = Slider(2500, range=0..10000)
construct_domain = ConstructDomain(DomainStart=Slider(1, range=0..10), DomainEnd=Slider(2.1, range=0..10))
construct_domain_2 = ConstructDomain(DomainStart=0, DomainEnd=number_slider_2)
series = Series(Start=0, Step=t1_2, Count=number_slider_2)
# Hops
curve_4 = Curve(curve_3)
explode = Explode(Curve=rectangle.Rectangle, Recursive=True)  # -> Segments, Vertices
brep_edges = BrepEdges(Brep=curve_4)  # -> Naked, Interior, NonManifold
construct_domain_3 = ConstructDomain(DomainStart=0, DomainEnd=number_slider_14)
construct_domain_4 = ConstructDomain(DomainStart=Slider(1, range=0..10), DomainEnd=Slider(4, range=0..10))
# predict_time
# predict_clean_area
bounding_rectangle = BoundingRectangle(Geometry=curve_3, Plane=PlaneXY(0, 0, 0), Axis=0, Slide=0, Union=False)  # -> Bounding, DimensionX, DimensionY
series_2 = Series(Start=0, Step=t1, Count=number_slider_14)
construct_point = ConstructPoint(XCoordinate=0, YCoordinate=0, ZCoordinate=0)
list_item = ListItem(List=explode.Segments, Index=0, Wrap=True)  # -> Item, Item1, Item2, Item3
construct_point_2 = ConstructPoint(XCoordinate=0, YCoordinate=0, ZCoordinate=0)
remap_numbers = RemapNumbers(Value=series, Source=construct_domain_2, Target=construct_domain)  # -> Mapped, Clipped
number = Number(bounding_rectangle.DimensionX)
number_2 = Number(bounding_rectangle.DimensionY)
construct_point_3 = ConstructPoint(XCoordinate=0, YCoordinate=0, ZCoordinate=0)
construct_point_4 = ConstructPoint(XCoordinate=0, YCoordinate=0, ZCoordinate=0)
construct_point_5 = ConstructPoint(XCoordinate=0, YCoordinate=0, ZCoordinate=0)
construct_point_6 = ConstructPoint(XCoordinate=0, YCoordinate=0, ZCoordinate=0)
construct_point_7 = ConstructPoint(XCoordinate=0, YCoordinate=0, ZCoordinate=0)
construct_point_8 = ConstructPoint(XCoordinate=0, YCoordinate=0, ZCoordinate=0)
construct_point_9 = ConstructPoint(XCoordinate=0, YCoordinate=0, ZCoordinate=0)
join_curves_3 = JoinCurves(Curves=brep_edges.Naked, Preserve=False)  # -> flatten(Curves)
rectangle_2 = Rectangle(Plane=construct_point, XSize=Slider(2, range=0..10), YSize=Slider(4, range=0..10), Radius=0)  # -> Rectangle, Length
evaluate_curve = EvaluateCurve(Curve=reparameterize(list_item.Item), Parameter=Slider(0.5, range=0..0.5))  # -> Point, Tangent, Angle
evaluate_curve_2 = EvaluateCurve(Curve=reparameterize(list_item.Item1), Parameter=Slider(0.1149, range=0..1))  # -> Point, Tangent, Angle
evaluate_curve_3 = EvaluateCurve(Curve=reparameterize(list_item.Item2), Parameter=Slider(0.269, range=0..1))  # -> Point, Tangent, Angle
evaluate_curve_4 = EvaluateCurve(Curve=reparameterize(list_item.Item3), Parameter=Slider(0.0037, range=0..1))  # -> Point, Tangent, Angle
number_slider_16 = Slider(5, range=0..10)
remap_numbers_2 = RemapNumbers(Value=series_2, Source=construct_domain_3, Target=construct_domain_4)  # -> Mapped, Clipped
clean_tree = CleanTree(RemoveNulls=True, RemoveInvalid=True, RemoveEmpty=False, Tree=join_curves_3)
polyline = PolyLine(Vertices=[construct_point_8, construct_point_9, construct_point_4, construct_point_3], Closed=True)
rectangle_3 = Rectangle(Plane=construct_point_2, XSize=remap_numbers.Mapped, YSize=remap_numbers_2.Mapped, Radius=0)  # -> Rectangle, Length
negative = Negative(Value=Slider(0.05, range=0..0.1))
polyline_2 = PolyLine(Vertices=[evaluate_curve.Point, evaluate_curve_2.Point, evaluate_curve_3.Point, evaluate_curve_4.Point], Closed=True)
t0 = Slider(0, range=0..1)
t1_3 = Slider(0, range=0..1)
t2 = Slider(0, range=0..1)
t3 = Slider(0.1619, range=0..1)
curve_5 = Curve(polyline)
explode_2 = Explode(Curve=rectangle_3.Rectangle, Recursive=True)  # -> Segments, Vertices
offset_curve = OffsetCurve(Curve=clean_tree, Distance=negative, Corners=1)
brep_edges_2 = BrepEdges(Brep=curve_5)  # -> Naked, Interior, NonManifold
area = Area(Geometry=curve_3)  # -> Area, Centroid
explode_3 = Explode(Curve=polyline_2, Recursive=True)  # -> Segments, Vertices
square = Square(
    Plane=PlaneXY(0, 0, 0),
    Size=Slider(4.196, range=0..10),
    ExtentX=Slider(100, range=0..100),
    ExtentY=Slider(50, range=0..100))  # -> flatten(Cells), Points
boundary_surfaces = BoundarySurfaces(Edges=polyline_2)
join_curves_4 = JoinCurves(Curves=brep_edges_2.Naked, Preserve=False)  # -> flatten(Curves)
plane_normal = PlaneNormal(Origin=area.Centroid, ZAxis=Vector(0, 0, 1))
list_item_2 = ListItem(List=explode_2.Segments, Index=0, Wrap=True)  # -> Item, Item1, Item2, Item3
settings_custom = SettingsCustom(
    StitchSeams=True,
    SimplePlanes=False,
    Refine=True,
    MinCount=16,
    MaxCount=400,
    AspectRatio=20,
    MaxDistance=0,
    MaxAngle=20,
    MinEdge=0,
    MaxEdge=Slider(0.08, range=0..100))
list_item_3 = ListItem(List=explode_3.Segments, Index=0, Wrap=True)  # -> Item, Item1, Item2, Item3
area_2 = Area(Geometry=square.Cells)  # -> Area, Centroid
dash_pattern_2 = DashPattern(Curve=reparameterize(square.Cells), Pattern=Slider(0.2, range=0..1))  # -> Dashes, Gaps
negative_2 = Negative(Value=Slider(0.05, range=0..0.1))
clean_tree_2 = CleanTree(RemoveNulls=True, RemoveInvalid=True, RemoveEmpty=False, Tree=join_curves_4)
curve_6 = Curve(list_item_3.Item3)
custom_preview_lineweights = CustomPreviewLineweights(Geometry=dash_pattern_2.Dashes, Shader=ColourSwatch(SwatchColor=RGB(26, 26, 26)), Absolute=False)
custom_preview_lineweights_2 = CustomPreviewLineweights(Geometry=dash_pattern.Dashes, Shader=colour_swatch, Absolute=False)  # disabled

number_slider_17 = Slider(0, range=0..100)
number_slider_18 = Slider(100, range=0..100)
number_slider_19 = Slider(500, range=0..500)
number_slider_20 = Slider(1, range=0..1)
number_slider_21 = Slider(500, range=1..500)
curve_7 = Curve(<curve referenced from the Rhino model>)
curve_8 = Curve(<curve referenced from the Rhino model>)
range = Range(Domain=Domain(0, 1), Steps=Slider(500, range=0..500))
divide_curve = DivideCurve(Curve=curve_7, Count=number_slider_19, Kinks=False)  # -> Points, Tangents, Parameters
divide_curve_2 = DivideCurve(Curve=curve_8, Count=number_slider_19, Kinks=False)  # -> Points, Tangents, Parameters
graph_mapper = GraphMapper(
    range,
    x0=0,
    x1=1,
    y0=0,
    y1=1,
    container_name="Bezier",
    cpx=[0, 0, 0.5204547644, 1],
    cpy=[0, 1, 0.4113398194, 0.002132713795])
list_item_4 = ListItem(List=divide_curve.Points, Index=number_slider_21, Wrap=True)
list_item_5 = ListItem(List=divide_curve_2.Points, Index=number_slider_21, Wrap=True)
get_camera = GetCamera(GetCamera=Toggle(True))  # -> Location, Target, LensLength, UpDirection
point = Point(Point(399.6043718, -608.0633813, 208.6026296))
point_2 = Point(Point(-98.19667953, -5.836110746, 42.84377522))
point_3 = Point(Point(-0.09587978706, 0.1236074767, 0.9876883406))
panel_3 = Panel("50")
shift_list = ShiftList(List=graph_mapper, Shift="-1", Wrap=invert(True))
panel_4 = Panel(get_camera.LensLength)
mass_addition = MassAddition(Input=shift_list)  # -> Result, PartialResults
bounds = Bounds(Numbers=mass_addition.PartialResults)
remap_numbers_3 = RemapNumbers(Value=mass_addition.PartialResults, Source=bounds, Target=Domain(0, 1))  # -> Mapped, Clipped
evaluate_length = EvaluateLength(Curve=curve_8, Length=remap_numbers_3.Mapped, Normalized=True)  # -> Point, Tangent, Parameter
shatter = Shatter(Curve=curve_8, Parameters=evaluate_length.Parameter)
list_item_6 = ListItem(List=evaluate_length.Point, Index=expr("x-1", number_slider_21), Wrap=True)
set_camera = SetCamera(CameraLocation=list_item_6, TargetLocation=list_item_4, Activate=Toggle(False))

evaluate_curve_5 = EvaluateCurve(Curve=reparameterize(list_item_2.Item), Parameter=t0)  # -> Point, Tangent, Angle
evaluate_curve_6 = EvaluateCurve(Curve=reparameterize(list_item_2.Item1), Parameter=t1_3)  # -> Point, Tangent, Angle
evaluate_curve_7 = EvaluateCurve(Curve=reparameterize(list_item_2.Item2), Parameter=t2)  # -> Point, Tangent, Angle
evaluate_curve_8 = EvaluateCurve(Curve=reparameterize(list_item_2.Item3), Parameter=t3)  # -> Point, Tangent, Angle
plane_normal_2 = PlaneNormal(Origin=area_2.Centroid, ZAxis=Vector(0, 0, 1))
evaluate_curve_9 = EvaluateCurve(Curve=reparameterize(curve_6), Parameter=Slider(0.1888, range=0..1))  # -> Point, Tangent, Angle
evaluate_curve_10 = EvaluateCurve(Curve=reparameterize(polyline_2), Parameter=Slider(0.1522, range=0..1))  # -> Point, Tangent, Angle
mesh_brep_3 = MeshBrep(Brep=boundary_surfaces, Settings=settings_custom)
offset_curve_2 = OffsetCurve(Curve=clean_tree_2, Distance=negative_2, Corners=1)
orient = Orient(Geometry=curve_3, Source=plane_normal, Target=plane_normal_2)  # -> Geometry, Transform
curve_9 = Curve(<curve referenced from the Rhino model>)
settings_custom_2 = SettingsCustom(
    StitchSeams=True,
    SimplePlanes=False,
    Refine=True,
    MinCount=16,
    MaxCount=400,
    AspectRatio=20,
    MaxDistance=0,
    MaxAngle=20,
    MinEdge=0,
    MaxEdge=Slider(0.25, range=0..100))
line_2 = Line(StartPoint=evaluate_curve_10.Point, EndPoint=evaluate_curve_9.Point)
boundary_surfaces_2 = BoundarySurfaces(Edges=offset_curve_2)
point_on_curve = PointOnCurve(offset_curve_2, parameter=0.357)
point_on_curve_2 = PointOnCurve(offset_curve_2, parameter=0.429)
point_on_curve_3 = PointOnCurve(offset_curve_2, parameter=0.832)
dash_pattern_3 = DashPattern(Curve=reparameterize(curve_9), Pattern=Slider(0.303, range=0..1))  # -> Dashes, Gaps
curve_10 = Curve(orient.Geometry)
curve_11 = Curve(curve_10)
brep_edges_3 = BrepEdges(Brep=curve_11)  # -> Naked, Interior, NonManifold
join_curves_5 = JoinCurves(Curves=brep_edges_3.Naked, Preserve=False)  # -> flatten(Curves)
triangulate = Triangulate(Mesh=mesh_brep_3)  # -> Mesh, Count
mesh_brep_4 = MeshBrep(Brep=boundary_surfaces_2, Settings=settings_custom_2)
polyline_3 = PolyLine(Vertices=[evaluate_curve_5.Point, evaluate_curve_6.Point, evaluate_curve_7.Point, evaluate_curve_8.Point], Closed=True)
negative_3 = Negative(Value=Slider(0.05, range=0..0.1))
clean_tree_3 = CleanTree(RemoveNulls=True, RemoveInvalid=True, RemoveEmpty=False, Tree=join_curves_5)
mesh_edges = MeshEdges(Mesh=triangulate.Mesh)  # -> NakedEdges, InteriorEdges, NonManifoldEdges
triangulate_2 = Triangulate(Mesh=mesh_brep_4)  # -> Mesh, Count
length = Length(Curve=explode_2.Segments)
boundary_surfaces_3 = BoundarySurfaces(Edges=offset_curve)
point_on_curve_4 = PointOnCurve(offset_curve, parameter=0.357)
point_on_curve_5 = PointOnCurve(offset_curve, parameter=0.59)
point_on_curve_6 = PointOnCurve(offset_curve, parameter=0.832)
offset_curve_3 = OffsetCurve(Curve=clean_tree_3, Distance=negative_3, Corners=1)
area_3 = Area(Geometry=polyline_3)  # -> Area, Centroid
division = Division(A=length, B="1000")
mesh_edges_2 = MeshEdges(Mesh=triangulate_2.Mesh)  # -> NakedEdges, InteriorEdges, NonManifoldEdges
settings_custom_3 = SettingsCustom(
    StitchSeams=True,
    SimplePlanes=False,
    Refine=True,
    MinCount=16,
    MaxCount=400,
    AspectRatio=20,
    MaxDistance=0,
    MaxAngle=20,
    MinEdge=0,
    MaxEdge=Slider(0.25, range=0..100))
line_3 = Line(StartPoint=point_on_curve, EndPoint=point_on_curve_3)
boundary_surfaces_4 = BoundarySurfaces(Edges=offset_curve_3)
point_on_curve_7 = PointOnCurve(offset_curve_3, parameter=0.348)
point_on_curve_8 = PointOnCurve(offset_curve_3, parameter=0.59)
point_on_curve_9 = PointOnCurve(offset_curve_3, parameter=0.708)
shortest_walk = ShortestWalk(Curves=mesh_edges.InteriorEdges, WantedPath=line_2)  # -> ShortestWalk, Succession, Direction, Length
division_2 = Division(A=area_3.Area, B="1000000")
shortest_walk_2 = ShortestWalk(Curves=mesh_edges_2.InteriorEdges, WantedPath=line_3)  # -> ShortestWalk, Succession, Direction, Length
number_slider_22 = Slider(0.1, range=0..100)
mesh_brep_5 = MeshBrep(Brep=boundary_surfaces_4, Settings=settings_custom_3)
custom_preview_lineweights_3 = CustomPreviewLineweights(Geometry=shortest_walk.ShortestWalk, Shader=ColourSwatch(SwatchColor=RGB(255, 255, 255)), Absolute=False)
triangulate_3 = Triangulate(Mesh=mesh_brep_5)  # -> Mesh, Count
discontinuity = Discontinuity(Curve=shortest_walk.ShortestWalk, Level=Slider(2, range=0..10))  # -> Points, Parameters
explode_4 = Explode(Curve=clean_tree, Recursive=True)  # -> Segments, Vertices
discontinuity_2 = Discontinuity(Curve=shortest_walk_2.ShortestWalk, Level=Slider(2, range=0..10))  # -> Points, Parameters
panel_5 = Panel(division)
panel_6 = Panel(division_2)
settings_custom_4 = SettingsCustom(
    StitchSeams=True,
    SimplePlanes=False,
    Refine=True,
    MinCount=16,
    MaxCount=400,
    AspectRatio=20,
    MaxDistance=0,
    MaxAngle=20,
    MinEdge=0,
    MaxEdge=Slider(0.25, range=0..100))

# ---- group: app name
panel_7 = Panel("/myMLWheelAtoB")

# ----
cull_index = CullIndex(List=discontinuity.Points, Indices="-1", Wrap=True)
mesh_edges_3 = MeshEdges(Mesh=triangulate_3.Mesh)  # -> NakedEdges, InteriorEdges, NonManifoldEdges
list_length = ListLength(List=discontinuity.Points)
circle = Circle(Plane=discontinuity.Points, Radius=Slider(0.40518, range=0..1))
multiplication_2 = Multiplication(A=number_slider_21, B=Slider(0.002, range=0..0.01))
line_4 = Line(StartPoint=point_on_curve_7, EndPoint=point_on_curve_9)
mesh_brep_6 = MeshBrep(Brep=boundary_surfaces_3, Settings=settings_custom_4)
panel_8 = Panel(list_length)
region_union = RegionUnion(Curves=circle)
shortest_walk_3 = ShortestWalk(Curves=mesh_edges_3.InteriorEdges, WantedPath=line_4)  # -> ShortestWalk, Succession, Direction, Length
concat = Concatenate(FragmentA="http://4b74-34-123-147-232.ngrok.io", FragmentB=panel_7)
area_4 = Area(Geometry=boundary_surfaces)  # -> Area, Centroid
unit_x = UnitX(Factor=Slider(0.0765, range=0..0.1))
hops = Hops(
    _Path=concat,
    Steps=list_length,
    Height=multiplication,
    Width=number_slider_3,
    CacheResultsInMemory=True,
    CacheSolveResults=True,
    RemoteDefinitionLocation="http://4b74-34-123-147-232.ngrok.io/myMLWheelAtoB",
    RemoteSolveVersion=(0, 1, 0),
    ShowInput_Enabled=False,
    ShowInput_Path=True,
    SynchronousSolve=True)
triangulate_4 = Triangulate(Mesh=mesh_brep_6)  # -> Mesh, Count
project = Project(Curve=region_union, Brep=boundary_surfaces, Direction=Vector(0, 0, 1))
move = Move(Geometry=discontinuity.Points, Motion=unit_x)  # -> Geometry, Transform
discontinuity_3 = Discontinuity(Curve=shortest_walk_3.ShortestWalk, Level=Slider(2, range=0..10))  # -> Points, Parameters
panel_9 = Panel(hops)
mesh_edges_4 = MeshEdges(Mesh=triangulate_4.Mesh)  # -> NakedEdges, InteriorEdges, NonManifoldEdges
panel_10 = Panel(area_4.Area)
curve_12 = Curve(rectangle.Rectangle)
list_item_7 = ListItem(List=explode_4.Segments, Index=0, Wrap=True)
list_item_8 = ListItem(List=explode_4.Segments, Index="1", Wrap=True)
line_5 = Line(StartPoint=point_on_curve_4, EndPoint=point_on_curve_6)
list_indices = ListIndices(List=discontinuity.Points)
surface_split = SurfaceSplit(Surface=boundary_surfaces, Curves=project)
length_2 = Length(Curve=list_item_7)  # -> flatten(Length)
concatenate = Concatenate(FragmentA=area_4.Area, FragmentB="m2", JoinSeparator=" ")
concatenate_2 = Concatenate(FragmentA=hops, FragmentB="mins", JoinSeparator=" ")
text_tag_3d = TextTag3D(
    Location=move.Geometry,
    Text=list_indices,
    Size=Slider(0.0591, range=0..1),
    Colour=ColourSwatch(SwatchColor=RGB(255, 255, 255)),
    Justification=7)
shortest_walk_4 = ShortestWalk(Curves=mesh_edges_4.InteriorEdges, WantedPath=line_5)  # -> ShortestWalk, Succession, Direction, Length
panel_11 = Panel(concatenate_2)
length_3 = Length(Curve=list_item_8)  # -> flatten(Length)
list_item_9 = ListItem(List=surface_split, Index=Slider(2, range=0..10), Wrap=True)
panel_12 = Panel(multiplication_2)  # disabled
negative_4 = Negative(Value=Slider(0.096, range=0..1))
shift_paths = ShiftPaths(Data=shortest_walk_4.ShortestWalk, Offset=-1)  # -> flatten(Data)
discontinuity_4 = Discontinuity(Curve=shortest_walk_4.ShortestWalk, Level=Slider(2, range=0..10))  # -> Points, Parameters
point_on_curve_10 = PointOnCurve(shortest_walk_4.ShortestWalk, parameter=0.326)
point_4 = Point(<point referenced from the Rhino model>)
unit_y = UnitY(Factor=negative_4)
list_length_2 = ListLength(List=discontinuity_4.Points)
list_item_10 = ListItem(List=shift_paths, Index=Slider(0, range=0..4999), Wrap=True)
number_slider_23 = Slider(1, range=0..1)
linear_array = LinearArray(Geometry=point_4, Direction=unit_y, Count=Slider(2, range=0..10))  # -> Geometry, Transform
division_3 = Division(A=list_length_2, B="2")
flatten_tree_2 = FlattenTree(Tree=list_length_2, Path="{0}")
concatenate_3 = Concatenate(FragmentA="time", FragmentB=concatenate_2, JoinSeparator=" ")
concatenate_4 = Concatenate(FragmentA="area", FragmentB=concatenate, JoinSeparator=" ")
bounds_2 = Bounds(Numbers=flatten_tree_2)
insert_items = InsertItems(List=discontinuity_4.Points, Item=point_on_curve_10, Indices=division_3, Wrap=True)
list_item_11 = ListItem(List=linear_array.Geometry, Index=0, Wrap=True)  # -> Item, Item1
construct_domain_5 = ConstructDomain(DomainStart=0, DomainEnd=multiplication_2)
shift_paths_2 = ShiftPaths(Data=insert_items, Offset=-1)
panel_13 = Panel(bounds_2)
sub_curve = SubCurve(BaseCurve=reparameterize(shortest_walk_3.ShortestWalk), Domain=construct_domain_5)
area_5 = Area(Geometry=boundary_surfaces_4)  # -> Area, Centroid
text_tag_3d_2 = TextTag3D(
    Location=graft([list_item_11.Item, list_item_11.Item1]),
    Text=graft([concatenate_3, concatenate_4]),
    Size=Slider(0.066, range=0..1),
    Justification=4)
surface_closest_point = SurfaceClosestPoint(Point=discontinuity_3.Points, Surface=boundary_surfaces_4)  # -> Point, UVPoint, Distance; disabled
flip = Flip(Surface=boundary_surfaces_4)  # -> Surface, Result; disabled
number_slider_24 = Slider(449.15, range=0..1000)  # disabled
end_points = EndPoints(Curve=sub_curve)  # -> Start, End
surface_closest_point_2 = SurfaceClosestPoint(Point=end_points.End, Surface=boundary_surfaces_4)  # -> Point, UVPoint, Distance
shift_paths_3 = ShiftPaths(Data=shift_paths_2, Offset="-2")
number_slider_25 = Slider(0.1438, range=0..1)  # disabled
evaluate_surface = EvaluateSurface(Surface=boundary_surfaces_4, Point=surface_closest_point_2.UVPoint)  # -> Point, Normal, UDirection, VDirection, Frame
evaluate_surface_2 = EvaluateSurface(Surface=flip.Surface, Point=surface_closest_point.UVPoint)  # -> Point, Normal, UDirection, VDirection, Frame; disabled
list_indices_2 = ListIndices(List=discontinuity_3.Points)  # disabled
tree_statistics = TreeStatistics(Tree=shift_paths_3)  # -> Paths, Length, Count
custom_preview_lineweights_4 = CustomPreviewLineweights(Geometry=sub_curve, Shader=ColourSwatch(SwatchColor=RGB(255, 255, 255)), Absolute=False)
radians = Radians(Degrees=number_slider_24)  # disabled
panel_14 = Panel(tree_statistics.Length)
rotate = Rotate(Geometry=evaluate_surface_2.Frame, Angle=radians, Plane=evaluate_surface_2.Frame)  # -> Geometry, Transform; disabled
text_tag_3d_3 = TextTag3D(Location=rotate.Geometry, Text=list_indices_2, Size=number_slider_25, Justification=7)  # disabled
multiplication_3 = Multiplication(A=Slider(1, range=0..1), B=Slider(10, range=0..10))
explode_5 = Explode(Curve=clean_tree, Recursive=True)  # -> Segments, Vertices
randomize_numbers = RandomizeNumbers(Number=Slider(31.95, range=0..100), Ratio=Slider(0.878, range=0..1), SeedOptional=multiplication_3)
area_6 = Area(Geometry=clean_tree)  # -> Area, Centroid
list_length_3 = ListLength(List=explode_5.Vertices)
number_slider_26 = Slider(2, range=0..10)
radians_2 = Radians(Degrees=Slider(90.835, range=0..100))
division_4 = Division(A=list_length_3, B="2")
arc = Arc(Plane=evaluate_surface.Frame, Radius=Slider(0.85, range=0..1), Angle=radians_2)  # -> Arc, Length
rotate_2 = Rotate(Geometry=arc.Arc, Angle=randomize_numbers, Plane=evaluate_surface.Frame)  # -> Geometry, Transform
divide_curve_3 = DivideCurve(Curve=rotate_2.Geometry, Count=Slider(3, range=0..10), Kinks=False)  # -> Points, Tangents, Parameters
list_item_12 = ListItem(List=explode_5.Vertices, Index=0, Wrap=True)  # -> flatten(Item)
list_item_13 = ListItem(List=explode_5.Vertices, Index=division_4, Wrap=True)  # -> flatten(Item)
number_slider_27 = Slider(0.2, range=0..1)  # disabled
line_6 = Line(StartPoint=evaluate_surface.Frame, EndPoint=divide_curve_3.Points)
number_slider_28 = Slider(0.287, range=0..1)  # disabled
line_7 = Line(StartPoint=area_6.Centroid, EndPoint=list_item_13)
line_8 = Line(StartPoint=area_6.Centroid, EndPoint=list_item_12)
dash_pattern_4 = DashPattern(Curve=reparameterize(line_6), Pattern=number_slider_27)  # -> Dashes, Gaps; disabled
amplitude = Amplitude(Vector=evaluate_surface.Normal, Amplitude=Slider(0.153, range=0..1))
colour_swatch_2 = ColourSwatch(SwatchColor=RGB(212, 212, 212))  # disabled
end_points_2 = EndPoints(Curve=line_7)  # -> Start, End
end_points_3 = EndPoints(Curve=line_8)  # -> Start, End
circle_2 = Circle(Plane=evaluate_surface.Frame, Radius=number_slider_28)  # disabled
custom_preview_lineweights_5 = CustomPreviewLineweights(Geometry=[dash_pattern_4.Dashes, sub_curve], Shader=colour_swatch_2, Absolute=False)  # disabled
vector_2pt = Vector2Pt(PointA=end_points_3.Start, PointB=end_points_3.End, Unitize=False)  # -> Vector, Length
boundary_surfaces_5 = BoundarySurfaces(Edges=circle_2)  # disabled
point_5 = Point(end_points_2.Start)
vector_2pt_2 = Vector2Pt(PointA=end_points_2.Start, PointB=end_points_2.End, Unitize=False)  # -> Vector, Length
point_6 = Point(end_points_3.Start)
negative_5 = Negative(Value=amplitude)
vector_display = VectorDisplay(Anchor=point_6, Vector=vector_2pt.Vector)
extrude = Extrude(Base=boundary_surfaces_5, Direction=negative_5)  # disabled
vector_display_2 = VectorDisplay(Anchor=point_5, Vector=vector_2pt_2.Vector)
cap_holes = CapHoles(Brep=extrude)  # disabled
colour_swatch_3 = ColourSwatch(SwatchColor=RGBA(255, 255, 255, 47))  # disabled
number_slider_29 = Slider(2960, range=0..10000)
angle = Angle(VectorA=vector_2pt.Vector, VectorB=vector_2pt_2.Vector)  # -> Angle, Reflex
custom_preview_materials = CustomPreviewMaterials(Geometry=cap_holes, DiffuseColor=colour_swatch_3)  # disabled
degrees = Degrees(Radians=angle.Angle)
list_item_14 = ListItem(List=flatten(boundary_surfaces_3), Index=number_slider_29, Wrap=True)
list_item_15 = ListItem(List=flatten(shortest_walk_4.ShortestWalk), Index=number_slider_29, Wrap=True)
explode_6 = Explode(Curve=curve_3, Recursive=True)  # -> Segments, Vertices
group = Group(Objects=[list_item_14, list_item_15])
square_2 = Square(Plane=PlaneXY(0, 0, 0), Size=Slider(4.196, range=0..10), ExtentX=5, ExtentY=Slider(1, range=0..1))  # -> flatten(Cells), Points
deconstruct = Deconstruct(Point=explode_6.Vertices)  # -> XComponent, YComponent, ZComponent
bounding_rectangle_2 = BoundingRectangle(Geometry=group, Plane=PlaneXY(0, 0, 0), Axis=0, Slide=0, Union=True)  # -> Bounding, DimensionX, DimensionY
curve_13 = Curve(square_2.Cells)
list_item_16 = ListItem(List=deconstruct.XComponent, Index=0, Wrap=True)  # -> flatten(Item), flatten(Item1), flatten(Item2), flatten(Item3)
list_item_17 = ListItem(List=deconstruct.YComponent, Index=0, Wrap=True)  # -> flatten(Item), flatten(Item1), flatten(Item2), flatten(Item3)
area_7 = Area(Geometry=curve_13)  # -> Area, Centroid
area_8 = Area(Geometry=bounding_rectangle_2.Bounding)  # -> Area, Centroid
line_9 = Line(StartPoint=point_on_curve_5, EndPoint=point_on_curve_6)
curve_14 = Curve(flatten(shortest_walk_4.ShortestWalk))
list_item_18 = ListItem(List=area_7.Centroid, Index=0, Wrap=True)
evaluate_curve_11 = EvaluateCurve(Curve=reparameterize(shortest_walk_4.ShortestWalk), Parameter=Slider(0.5, range=0..1))  # -> Point, Tangent, Angle
plane_normal_3 = PlaneNormal(Origin=area_8.Centroid, ZAxis=Vector(0, 0, 1))
plane_normal_4 = PlaneNormal(Origin=list_item_18, ZAxis=Vector(0, 0, 1))
offset_curve_4 = OffsetCurve(Curve=line_9, Plane=PlaneXY(0, 0, 0), Distance=Slider(0.2, range=0..1), BothSides=True, Kinks=0, CapType=1)  # -> flatten(Offset)
area_9 = Area(Geometry=flatten(offset_curve))  # -> Area, Centroid
point_7 = Point(flatten(point_on_curve_6))
point_8 = Point(flatten(point_on_curve_4))
flatten_tree_3 = FlattenTree(Tree=evaluate_curve_11.Point, Path="{0}")
length_4 = Length(Curve=curve_14)
area_10 = Area(Geometry=offset_curve_4)  # -> Area, Centroid
deconstruct_2 = Deconstruct(Point=point_7)  # -> XComponent, YComponent, ZComponent
deconstruct_3 = Deconstruct(Point=point_8)  # -> XComponent, YComponent, ZComponent
orient_2 = Orient(Geometry=group, Source=plane_normal_3, Target=plane_normal_4)  # -> Geometry, Transform
deconstruct_4 = Deconstruct(Point=flatten_tree_3)  # -> XComponent, YComponent, ZComponent
panel_15 = Panel(area_10.Area)
ungroup = Ungroup(Group=orient_2.Geometry)
division_5 = Division(A=area_10.Area, B=area_9.Area)
list_item_19 = ListItem(List=ungroup, Index=0, Wrap=True)  # -> Item, Item1
smaller_than = SmallerThan(FirstNumber=division_5, SecondNumber=Slider(0.35, range=0..1))  # -> SmallerThan, OrEqualTo
bounds_3 = Bounds(Numbers=division_5)
unit_x_2 = UnitX(Factor=Slider(0.0765, range=0..0.1))
custom_preview_materials_2 = CustomPreviewMaterials(Geometry=list_item_19.Item, DiffuseColor=ColourSwatch(SwatchColor=RGB(69, 69, 69)))
discontinuity_5 = Discontinuity(Curve=list_item_19.Item1, Level=Slider(2, range=0..10))  # -> Points, Parameters
custom_preview_lineweights_6 = CustomPreviewLineweights(Geometry=list_item_19.Item1, Shader=ColourSwatch(SwatchColor=RGB(255, 255, 255)), Absolute=False)
panel_16 = Panel(bounds_3)
move_2 = Move(Geometry=discontinuity_5.Points, Motion=unit_x_2)  # -> Geometry, Transform
integer = Integer(smaller_than.SmallerThan)
panel_17 = Panel(integer)
list_indices_3 = ListIndices(List=discontinuity_5.Points)

meters = Slider(0.25, range=0..10)
seconds = Slider(30, range=0..100)
multiplication_4 = Multiplication(A=length_4, B=seconds)
division_6 = Division(A=multiplication_4, B=meters)
division_7 = Division(A=division_6, B="60")

text_tag_3d_4 = TextTag3D(
    Location=move_2.Geometry,
    Text=list_indices_3,
    Size=Slider(0.0591, range=0..1),
    Colour=ColourSwatch(SwatchColor=RGB(255, 255, 255)),
    Justification=7)
bounding_rectangle_3 = BoundingRectangle(Geometry=ungroup, Plane=PlaneXY(0, 0, 0), Axis=0, Slide=0, Union=True)  # -> Bounding, DimensionX, DimensionY
panel_18 = Panel(division_7)
boolean_toggle = BooleanToggle(True)  # disabled
file_path = FilePath("C:\Users\secg\Documents\iokan\projects\MACAD\AIA21\AIA-data_encoding\repo_reference_01\Grasshopper_DQN_b\data_encoding_01\")  # disabled
# clean area
# curve_length
# Steps
# Degrees
panel_19 = Panel(file_path)  # disabled

number_slider_30 = Slider(50, range=0..50)
t2_2 = Slider(0.4, range=0..1)
t0_2 = Slider(0.4, range=0..1)
t1_4 = Slider(1, range=0..1)
t3_2 = Slider(1, range=0..1)
construct_domain_6 = ConstructDomain(DomainStart=0, DomainEnd=number_slider_30)
construct_domain_7 = ConstructDomain(DomainStart=0, DomainEnd=1)
construct_domain_8 = ConstructDomain(DomainStart=0, DomainEnd=1)
construct_domain_9 = ConstructDomain(DomainStart=0, DomainEnd=1)

series_3 = Series(Start=0, Step=t0_2, Count=number_slider_30)
series_4 = Series(Start=0, Step=t1_4, Count=number_slider_30)
series_5 = Series(Start=0, Step=t2_2, Count=number_slider_30)
series_6 = Series(Start=0, Step=t3_2, Count=number_slider_30)

construct_domain_10 = ConstructDomain(DomainStart=0, DomainEnd=1)
panel_20 = Panel("0 to 9")

remap_numbers_4 = RemapNumbers(Value=series_3, Source=construct_domain_6, Target=construct_domain_10)  # -> Mapped, Clipped
remap_numbers_5 = RemapNumbers(Value=series_4, Source=construct_domain_6, Target=construct_domain_8)  # -> Mapped, Clipped
remap_numbers_6 = RemapNumbers(Value=series_5, Source=construct_domain_6, Target=construct_domain_7)  # -> Mapped, Clipped
remap_numbers_7 = RemapNumbers(Value=series_6, Source=construct_domain_6, Target=construct_domain_9)  # -> Mapped, Clipped
panel_21 = Panel(remap_numbers_6.Mapped)
panel_22 = Panel(remap_numbers_7.Mapped)

panel_23 = Panel(remap_numbers_4.Mapped)
evaluate_curve_12 = EvaluateCurve(Curve=reparameterize(list_item_2.Item), Parameter=remap_numbers_4.Mapped)  # -> Point, Tangent, Angle
evaluate_curve_13 = EvaluateCurve(Curve=reparameterize(list_item_2.Item1), Parameter=remap_numbers_5.Mapped)  # -> Point, Tangent, Angle
evaluate_curve_14 = EvaluateCurve(Curve=reparameterize(list_item_2.Item2), Parameter=remap_numbers_6.Mapped)  # -> Point, Tangent, Angle
evaluate_curve_15 = EvaluateCurve(Curve=reparameterize(list_item_2.Item3), Parameter=remap_numbers_7.Mapped)  # -> Point, Tangent, Angle
graft_tree = GraftTree(Tree=evaluate_curve_15.Point, IncludeEmptyLists=True, IncludeNullItems=True)
graft_tree_2 = GraftTree(Tree=evaluate_curve_12.Point, IncludeEmptyLists=True, IncludeNullItems=True)
graft_tree_3 = GraftTree(Tree=evaluate_curve_13.Point, IncludeEmptyLists=True, IncludeNullItems=True)
graft_tree_4 = GraftTree(Tree=evaluate_curve_14.Point, IncludeEmptyLists=True, IncludeNullItems=True)
polyline_4 = PolyLine(Vertices=[graft_tree_2, graft_tree_3, graft_tree_4, graft_tree], Closed=True)
shift_paths_4 = ShiftPaths(Data=polyline_4, Offset=-1)  # -> flatten(Data)

series_7 = Series(Start=0, Step=1, Count=Slider(5000, range=0..5000))
panel_24 = Panel(shift_paths_4)
list_item_20 = ListItem(List=shift_paths_4, Index=Slider(5000, range=0..5000), Wrap=True)
list_item_21 = ListItem(List=shift_paths_4, Index=series_7, Wrap=True)
curve_closest_point = CurveClosestPoint(Point=evaluate_curve_14.Point, Curve=list_item_2.Item2)  # -> Point, Parameter, Distance
curve_closest_point_2 = CurveClosestPoint(Point=evaluate_curve_15.Point, Curve=list_item_2.Item3)  # -> Point, Parameter, Distance
curve_closest_point_3 = CurveClosestPoint(Point=evaluate_curve_12.Point, Curve=list_item_2.Item)  # -> Point, Parameter, Distance
curve_closest_point_4 = CurveClosestPoint(Point=evaluate_curve_13.Point, Curve=list_item_2.Item1)  # -> Point, Parameter, Distance
flatten_tree_4 = FlattenTree(Tree=curve_closest_point_2.Parameter, Path="{0}")
flatten_tree_5 = FlattenTree(Tree=curve_closest_point.Parameter, Path="{0}")
flatten_tree_6 = FlattenTree(Tree=curve_closest_point_3.Parameter, Path="{0}")
flatten_tree_7 = FlattenTree(Tree=curve_closest_point_4.Parameter, Path="{0}")
panel_25 = Panel(flatten_tree_6)
panel_26 = Panel(flatten_tree_5)
panel_27 = Panel(flatten_tree_7)
panel_28 = Panel(flatten_tree_4)
entwine = Entwine(
    Branch00=area_9.Area,
    Branch01=area_10.Area,
    Branch02=division_5,
    Branch03=length_4,
    Branch04=tree_statistics.Length,
    Branch05=division_7,
    Branch06=number_2,
    Branch07=number,
    Branch08=list_item_16.Item,
    Branch09=list_item_16.Item1,
    Branch010=list_item_16.Item2,
    Branch011=list_item_16.Item3,
    Branch012=list_item_17.Item,
    Branch013=list_item_17.Item1,
    Branch014=list_item_17.Item2,
    Branch015=list_item_17.Item3,
    Branch016=flatten_tree_6,
    Branch017=flatten_tree_7,
    Branch018=flatten_tree_5,
    Branch019=flatten_tree_4,
    Branch020=integer,
    FlattenInputs=True)  # -> simplify(Result)
flip_matrix = FlipMatrix(Data=entwine)
data = Data(flip_matrix)
python = GhPythonScript(write=boolean_toggle, path=file_path, values=data)  # -> out; inputs values: tree; disabled
# ---------- python: Python ----------
import ghpythonlib.treehelpers as th

values = th.tree_to_list(values, lambda x:x)

import csv


filename = path + 'data_v1_9.csv' 
with open(filename, 'w') as csvfile:
    writer = csv.writer(csvfile, delimiter=',', quoting=csv.QUOTE_MINIMAL)
    writer.writerow(['area','clean_area','per_clean_area','curve_length','steps','time','height','width','x_a', 'x_b', 'x_c', 'x_d','y_a','y_b','y_c','y_d','p_a','p_b','p_c','p_d','bin'])
    for row in values:
        print(row)
        writer.writerow(row)
# ---------- end python ----------
panel_29 = Panel(flip_matrix)
panel_30 = Panel(data)
data_2 = Data(entwine)  # disabled
# area
# Low_High
panel_31 = Panel(data_2)  # disabled
